# Grasshopper definition DifferentialGrowthCurve.gh (Grasshopper 1.0.7)

# ---- group: Wrap Complex Geometry
trigger = Trigger(Interval=1, TimerInterval=5, Target=c_script)  # disabled
curve = Curve(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)
mesh = Mesh(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)
c_script = CSharpScript(
    originalCurve=curve,
    mesh=mesh,
    reset=Button(),
    division=Slider(50, range=0..100),
    DivideLength=Slider(1.5, range=0..10),
    bendingWeight=Slider(0.013, range=0.01..0.02),
    radius=Slider(0.2, range=0..1))  # -> out, A, B, C; inputs originalCurve: Curve, mesh: Mesh, reset: Boolean, division: Int32, DivideLength: Double, bendingWeight: Double, radius: Double, x: Double
# ---------- c_script: C# ----------
    //reset
    if(reset || pts == null)
    {
      //pull curve to the mesh
      Curve c = mesh.PullCurve(originalCurve, 0.01);
      //divide the new curve to get a list of points
      Point3d[] p = new Point3d[division];
      pts = new List<Point3d>();
      //c.DivideByCount(DivideLength, false, out p);
      p = c.DivideEquidistant(DivideLength);
      //store the date to pts
      for(int i = 0; i < p.Length;i++)
      {
        pts.Add(p[i]);
      }
      ptest = p;
      //store radius
      r = 0.6 * DivideLength;
      m = mesh;
    }
    C = ptest;

    //initialize forces and forcenums
    forces = new List<Vector3d>();
    forceNums = new List<double>();
    for(int i = 0; i < pts.Count;i++)
    {
      forces.Add(new Vector3d(0.0, 0.0, 0.0));
      forceNums.Add(0.0);
    }

    //collisions
    ProcessCollisions();

    //bending
    Bending();

    //move
    Move();

    //output
    A = pts;
    B = Curve.CreateInterpolatedCurve(pts, 3, CurveKnotStyle.ChordPeriodic);

    //proliferate
    Proliferate();
# ---------- c_script: C# additional code ----------
  //define a persistent variable to store point locations
  List<Point3d> pts;

  //define two list to store forces and force number for each point
  List<Vector3d> forces;
  List<double> forceNums;

  //radius container
  double r;
  //mesh
  Mesh m;
  //point
  Point3d[] ptest;

  //collisions
  public void ProcessCollisions()
  {
    for(int i = 0; i < pts.Count; i++)
    {

      //collisions
      //factor
      double m = 1.0;
      for(int j = i + 1; j < pts.Count; j++)
      {
        Point3d pi = pts[i];
        Point3d pj = pts[j];
        Vector3d dis = pi - pj;
        if(dis.Length < 2 * r)
        {
          dis.Unitize();
          Vector3d force = dis * 0.5 * (2 * r - pi.DistanceTo(pj));
          forces[i] += m * force;
          forces[j] -= m * force;
          forceNums[i] += 1.0;
          forceNums[j] += 1.0;
        }
      }

      //pull back
      double k = 1.0;
      //find last point and next point
      int last;
      int next;
      //wrap
      if(i == 0)
      {
        next = i + 1;
        last = pts.Count - 1;
      }else if( i == pts.Count - 1)
      {
        next = 0;
        last = i - 1;
      }else
      {
        last = i - 1;
        next = i + 1;
      }
      //find all pts
      Point3d pt = pts[i];
      Point3d lastPt = pts[last];
      Point3d nextPt = pts[next];
      if(pt.DistanceTo(lastPt) > 2 * r)
      {
        Vector3d pullVec = lastPt - pt;
        pullVec.Unitize();
        pullVec *= 0.5 * (pt.DistanceTo(lastPt) - 2 * r);
        forces[i] += k * pullVec;
        forces[last] -= k * pullVec;
        forceNums[i] += 1.0;
        forceNums[last] += 1.0;
      }
      if(pt.DistanceTo(nextPt) > 2 * r)
      {
        Vector3d pullVec = nextPt - pt;
        pullVec.Unitize();
        pullVec *= 0.5 * (pt.DistanceTo(nextPt) - 2 * r);
        forces[i] += k * pullVec;
        forces[next] -= k * pullVec;
        forceNums[i] += 1.0;
        forceNums[next] += 1.0;
      }
    }
  }

  //proliferate
  public void Proliferate()
  {
    for(int i = 0; i < pts.Count; i++)
    {
      //wrap
      int last;
      int next;
      if(i == 0)
      {
        last = pts.Count - 1;
        next = i + 1;
      }else if( i == pts.Count - 1)
      {
        last = i - 1;
        next = 0;
      }else
      {
        last = i - 1;
        next = i + 1;
      }
      //next point
      Point3d lastPt = pts[last];
      Point3d pt = pts[i];
      Point3d nextPt = pts[next];
      //two vectors
      Vector3d v1 = lastPt - pt;
      Vector3d v2 = nextPt - pt;
      //angle
      double angle = Vector3d.VectorAngle(v1, v2);

      //add new point
      if(pts[i].DistanceTo(nextPt) >= 1.99 * r)
      {
        Point3d newPt = 0.5 * (pts[i] + nextPt);
        Point3d projectPt = m.ClosestPoint(newPt);
        pts.Insert(i + 1, projectPt);
      }

      //differential growth
      /*if(angle < 0.5 * Math.PI)
      {
      if(pts[i].DistanceTo(nextPt) >= 1.9 * r)
      {
      Point3d newPt = 0.5 * (pts[i] + nextPt);
      Point3d projectPt = m.ClosestPoint(newPt);
      pts.Insert(i + 1, projectPt);
      }
      }else{
      if(pts[i].DistanceTo(nextPt) >= 1.99 * r)
      {
      Point3d newPt = 0.5 * (pts[i] + nextPt);
      Point3d projectPt = m.ClosestPoint(newPt);
      pts.Insert(i + 1, projectPt);
      }
      }*/
    }
  }

  //bending
  public void Bending()
  {
    for(int i = 0;i < pts.Count;i++)
    {
      //weight
      double n = 0.02;
      //find last point and next point
      int last;
      int next;
      //wrap
      if(i == 0)
      {
        next = i + 1;
        last = pts.Count - 1;
      }else if( i == pts.Count - 1)
      {
        next = 0;
        last = i - 1;
      }else
      {
        last = i - 1;
        next = i + 1;
      }
      //3 points
      Point3d pt = pts[i];
      Point3d nextPt = pts[next];
      Point3d lastPt = pts[last];
      //2 vector3
      Vector3d v1 = lastPt - pt;
      Vector3d v2 = nextPt - pt;
      Vector3d bending = v1 + v2;
      bending.Unitize();
      double angle = Vector3d.VectorAngle(v1, v2);
      double factor = Remap(0, Math.PI, 0.2, 0.0, angle);
      bending *= n * factor;
      forces[i] += bending;
      forceNums[i] += n;

    }
  }

  //remap
  public double Remap(double s1, double s2, double t1, double t2, double v)
  {
    return (t2 - t1) / (s2 - s1) * (v - s1) + t1;
  }

  //move
  public void Move()
  {
    for(int i = 0; i < pts.Count; i++)
    {
      pts[i] += forces[i] / forceNums[i];
    }
    //pullback to mesh
    Point3d[] p = m.PullPointsToMesh(pts);
    for(int i = 0; i < p.Length; i++)
    {
      pts[i] = p[i];
    }
  }
# ---------- end c_script ----------
point = Point(c_script.A)
panel = Panel(c_script.A)
panel_2 = Panel(c_script.out)
point_2 = Point(c_script.C)
curve_2 = Curve(c_script.B)
interpolate = Interpolate(Vertices=point, Degree=3, Periodic=invert(False), KnotStyle=1)  # -> Curve, Length, Domain; disabled
custom_preview = CustomPreview(Geometry=curve_2, Material=ColourSwatch(SwatchColor=RGB(126, 170, 224)))

# ---- group: 2d Curve
curve_3 = Curve(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)
boundary_surfaces = BoundarySurfaces(Edges=curve_3)
trigger_2 = Trigger(Interval=1, TimerInterval=5, Target=c_script_2)  # disabled
curve_4 = Curve(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)
mesh_2 = Mesh(boundary_surfaces)
c_script_2 = CSharpScript(
    originalCurve=curve_4,
    mesh=mesh_2,
    reset=Button(),
    division=Slider(50, range=0..100),
    DivideLength=Slider(15, range=0..100),
    bendingWeight=Slider(0.013, range=0.01..0.02),
    radius=Slider(0.2, range=0..1))  # -> out, A, B, C; inputs originalCurve: Curve, mesh: Mesh, reset: Boolean, division: Int32, DivideLength: Double, bendingWeight: Double, radius: Double; same code as c_script
point_3 = Point(c_script_2.A)
data = Data(c_script_2.C)
panel_3 = Panel(c_script_2.A)
curve_5 = Curve(c_script_2.B)
panel_4 = Panel(c_script_2.out)
interpolate_2 = Interpolate(Vertices=point_3, Degree=3, Periodic=invert(False), KnotStyle=1)  # -> Curve, Length, Domain; disabled
custom_preview_2 = CustomPreview(Geometry=curve_5, Material=ColourSwatch(SwatchColor=RGB(185, 214, 250)))
