# Grasshopper definition Gcode.gh (Grasshopper 1.0.7)

# ----
# Input Curve
curve = Curve(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)

curve_2 = Curve(curve)
divide_curve = DivideCurve(Curve=curve_2, Count=Slider(1942, range=0..10000), Kinks=invert(False))  # -> Points, Tangents, Parameters
interpolate = Interpolate(Vertices=divide_curve.Points, Degree=expr("1", 1), Periodic=False, KnotStyle=1)  # -> Curve, Length, Domain
explode = Explode(Curve=interpolate.Curve, Recursive=True)  # -> Segments, Vertices
point = Point(flatten(explode.Vertices))
deconstruct = Deconstruct(Point=point)  # -> XComponent, YComponent, ZComponent
length = Length(Curve=explode.Segments)
multiplication = Multiplication(A=length, B=Slider(0.1, range=0..1))

# ---- group: Set Extruder Absolute Mode
panel = Panel("M83")

# ----
panel_2 = Panel("""M140 S0
M204 S4000
M205 X20 Y20
M107
M104 S0
M140 S0
;Retract the filament
G92 E1
G1 E-1 F300
G28 X0 Y0
M84
M83 ;relative extrusion mode
M104 S0""")

# ---- group: Prime the extruder
panel_3 = Panel(""";Prime the extruder
G92 E0
G1 F200 E3
G92 E0
M141 S28
G92 E0
G92 E0
G1 F2400 E-6""")

# ----
panel_4 = Panel(""";LAYER_COUNT:127
;LAYER:0
M107
M204 S2000
M205 X10 Y10""")

# ---- group: Move
panel_5 = Panel("G1 Z15.0 F6000 ;Move the platform down 15mm")

# ---- group: Bed temperature
panel_6 = Panel("M140 S60")

# ---- group: Get Extruder Temp
panel_7 = Panel("M105")

# ---- group: Wait bed temp
panel_8 = Panel("M190 S60")

# ---- group: Extruder temp
panel_9 = Panel("M104 S200")

# ---- group: Get Extruder Temp
panel_10 = Panel("M105")

# ---- group: Set Extruder Temp and wait
panel_11 = Panel("M109 S200")

# ---- group: Set Extruder Relative Mode
panel_12 = Panel("M82")

# ---- group: Home
panel_13 = Panel("G28")

# ----
concatenate = Concatenate(
    A="G1 F750",
    X=" X",
    Xnum=deconstruct.XComponent,
    Y=" Y",
    Ynum=deconstruct.YComponent,
    Z=" Z",
    Znum=deconstruct.ZComponent,
    E=" E",
    Enum=multiplication)
panel_14 = Panel(concatenate)
merge = Merge(
    Data1=panel_6,
    Data2=panel_7,
    Data3=panel_8,
    Data4=panel_9,
    Data5=panel_10,
    Data6=panel_11,
    Data7=panel,
    Data8=panel_13,
    Data9=panel_5,
    Data10=panel_3,
    Data11=panel_4,
    Data12=flatten(concatenate),
    Data13=panel_2)
panel_15 = Panel(merge)
